# Grasshopper definition Grids_Populate_Arrays.gh (Grasshopper 1.0.4)
# Copyright: Use it.  Mod it.  Share it. Just please give credit and kepp this party going.

# ---- group: Grids / Radial Grid
pt = ConstructPoint(XCoordinate=Slider(14, range=0..100), YCoordinate=Slider(47, range=0..100), ZCoordinate=0)
radgrid = Radial(Plane=pt, Size=Slider(2, range=0..10), ExtentR=Slider(7, range=0..10), ExtentP=Slider(20, range=0..100))  # -> Cells, Points
cir = Circle(Plane=radgrid.Points, Radius=Slider(0.6, range=0..1))

# ---- group: Grids / Hexagonal Grid
pt_2 = ConstructPoint(XCoordinate=Slider(0, range=0..100), YCoordinate=Slider(70, range=0..100), ZCoordinate=0)
hexgrid = Hexagonal(Plane=pt_2, Size=Slider(2, range=0..10), ExtentX=Slider(9, range=0..100), ExtentY=Slider(7, range=0..100))  # -> Cells, Points
cir_2 = Circle(Plane=hexgrid.Points, Radius=Slider(0.79, range=0..1))

# ---- group: Random Populate / Randomly Populate a 2D Rectagular Area
pt_3 = ConstructPoint(XCoordinate=Slider(45, range=0..100), YCoordinate=Slider(100, range=0..100), ZCoordinate=0)
rectangle = Rectangle(Plane=pt_3, XSize=Slider(20, range=0..100), YSize=Slider(30, range=0..100), Radius=0)  # -> Rectangle, Length
pop2d = Populate2D(Region=rectangle.Rectangle, Count=Slider(100, range=0..100), Seed=Slider(51, range=0..100))
cir_3 = Circle(Plane=pop2d, Radius=Slider(0.49, range=0..1))

# ---- group: Random Populate
pt_4 = ConstructPoint(XCoordinate=Slider(55, range=0..100), YCoordinate=Slider(26, range=0..100), ZCoordinate=0)
cone = Cone(Base=pt_4, Radius=Slider(10, range=0..100), Length=Slider(21, range=0..100))  # -> Cone, Tip
popgeo = PopulateGeometry(Geometry=cone.Cone, Count=Slider(100, range=0..100), Seed=Slider(29, range=0..100))
sph = Sphere(Base=popgeo, Radius=Slider(0.5, range=0..1))

# ---- group: Arrays / Curve Array
pt_5 = ConstructPoint(XCoordinate=Slider(100, range=0..100), YCoordinate=Slider(33, range=0..100), ZCoordinate=0)
polygon = Polygon(Plane=pt_5, Radius=Slider(20, range=0..100), Segments=5, FilletRadius=0)  # -> Polygon, Length
end = EndPoints(Curve=polygon.Polygon)  # -> Start, End
cir_4 = Circle(Plane=end.Start, Radius=Slider(0.5, range=0..1))
arrcurve = CurveArray(Geometry=cir_4, Curve=polygon.Polygon, Count=Slider(20, range=0..100))  # -> Geometry, Transform

# ---- group: Arrays / Polar Array
pt_6 = ConstructPoint(XCoordinate=Slider(100, range=0..100), YCoordinate=Slider(74, range=0..100), ZCoordinate=0)
pt_7 = ConstructPoint(XCoordinate=Slider(86, range=0..100), YCoordinate=Slider(80, range=0..100), ZCoordinate=0)
cir_5 = Circle(Plane=pt_7, Radius=Slider(1, range=0..1))
arrpolar = PolarArray(Geometry=cir_5, Plane=pt_6, Count=Slider(16, range=0..100), Angle=degrees(Slider(199.52, range=0..360)))  # -> Geometry, Transform

# ---- group: Arrays / Rectangular Array
pt_8 = ConstructPoint(XCoordinate=Slider(90, range=0..100), YCoordinate=Slider(100, range=0..100), ZCoordinate=0)
rectangle_2 = Rectangle(Plane=PlaneXY(0, 0, 0), XSize=Slider(2, range=0..100), YSize=Slider(4, range=0..100), Radius=0)  # -> Rectangle, Length
cir_6 = Circle(Plane=pt_8, Radius=Slider(0.5, range=0..1))
arrrec = RectangularArray(Geometry=cir_6, Cell=rectangle_2.Rectangle, XCount=Slider(12, range=0..100), YCount=Slider(8, range=0..100))  # -> Geometry, Transform

# ---- group: Grids / Hexagonal Grid
number_slider = Slider(15, range=0..100)
number_slider_2 = Slider(15, range=0..100)
number_slider_3 = Slider(2, range=0..10)
pt_9 = ConstructPoint(XCoordinate=Slider(0, range=0..100), YCoordinate=Slider(0, range=0..100), ZCoordinate=0)

# ---- group: Grids
number_slider_4 = Slider(100, range=0..100)
trigrid = Triangular(Plane=pt_9, Size=number_slider_3, ExtentX=number_slider, ExtentY=number_slider_2)  # -> Cells, Points

# ---- group: Grids / Rectangular Grid
pt_10 = ConstructPoint(XCoordinate=Slider(0, range=0..100), YCoordinate=number_slider_4, ZCoordinate=0)
recgrid = Rectangular(
    Plane=pt_10,
    SizeX=Slider(2, range=0..10),
    SizeY=Slider(3, range=0..10),
    ExtentX=Slider(15, range=0..100),
    ExtentY=Slider(10, range=0..100))  # -> Cells, Points
cir_7 = Circle(Plane=recgrid.Points, Radius=Slider(1, range=0..1))

# ---- group: Grids / Hexagonal Grid (continued)
cir_8 = Circle(Plane=trigrid.Points, Radius=Slider(0.5, range=0..1))

# ---- group: Random Populate / Randomly Populate a 3D Box Area
number_slider_5 = Slider(20, range=0..100)
number_slider_6 = Slider(30, range=0..100)
number_slider_7 = Slider(100, range=0..100)
pt_11 = ConstructPoint(XCoordinate=Slider(45, range=0..100), YCoordinate=Slider(53, range=0..100), ZCoordinate=0)
number_slider_8 = Slider(20, range=0..100)

# ---- group: Random Populate
box = DomainBox(Base=pt_11, X=number_slider_5, Y=number_slider_6, Z=Slider(25, range=0..100))
pop3d = Populate3D(Region=box, Count=number_slider_7, Seed=number_slider_8)

# ---- group: Random Populate / Randomly Populate a 3D Box Area (continued)
sph_2 = Sphere(Base=pop3d, Radius=Slider(0.6, range=0..1))
