# Grasshopper definition cube_pattern_quarter_sheet.gh (Grasshopper 0.9.76)
# Copyright: Use it.  Mod it.  Share it. Just please give credit and kepp this party going.
# Copyright: Use it.  Mod it.  Share it. Just please give credit and keep this party going.

# ---- group: my pattern / position and create hex grid
pt = ConstructPoint(XCoordinate=Slider(-0.46, range=-1..0), YCoordinate=Slider(-0.72, range=-1..0), ZCoordinate=0)
hexgrid = Hexagonal(Plane=pt, Size=Slider(0.48, range=0..1), ExtentX=Slider(9, range=0..10), ExtentY=Slider(8, range=0..10))  # -> Cells, Points

# ---- group: keep and re-use
# Study this definition to understand what is happening. The group headings should help walk you through it. Turning on "preview selected geometry" then clicking through the definition will also help you see what is going on in each step. Don't worry about understanding what is happening in "Cube Magic" for now.
# 
# Everything in the yellow box is an example pattern. Once you have a basic understanding of the definition, delete the yellow section and create your own pattern.
# 
# Keep everything in the blue boxes. You will re-use these parts to make your life easier.
# 
# Import the sample cube face curve into your pattern definition. You'll probably want to keep the .25" offset as a margin.
# 
# Create your pattern definition by playing with diferent curve geometries, grid tools, and other components that create interesting repitition (series, random, arrays, etc).
# 
# Once you have something you like, plug that output into the "Cut" and/or "Engrave" inputs on the Cube Magic component. This will place your geometry into the cube layout. Use the "bake" buttons to bake this geometry into your Rhino file.
# 
# Then move the "face selector" slider to choose a taget face fresh square. Adjust inputs in your pattern to create a new variation. Bake again. Repeat until all six faces have a unique pattern variation.
# 
# Save the .gh file and the Rhino .3dm file.
# 
# Take the Rhino file to the laser cutter and cut it. If you have your GH file open while laser cutting, rember to hide the GH output.
# 
# Lastly, fold up your cut pieces and glue it together into a cube.
number_slider = Slider(4.8, range=0..10)
rectangle = Rectangle(Plane=PlaneXY(0, 0, 0), XSize=number_slider, YSize=number_slider, Radius=0)  # -> Rectangle, Length
box = DomainBox(Base=PlaneXY(0, 0, 0), X=number_slider, Y=number_slider, Z=number_slider)
bake_pattern = Button()
press_once = Button()

# ---- group: keep and re-use / offset the face square to give a margin to your pattern
neg = Negative(Value=Slider(0.25, range=0..1))
offset = Offset(Curve=rectangle.Rectangle, Distance=neg, Plane=PlaneXY(0, 0, 0), Corners=1)

# ---- group: my pattern / create hex cut pattern
rotate = Rotate(Geometry=hexgrid.Cells, Angle=degrees(Slider(30, range=0..90)), Plane=hexgrid.Points)  # -> Geometry, Transform
offset_2 = Offset(Curve=rotate.Geometry, Distance=Slider(-0.13, range=-1..1), Plane=PlaneXY(0, 0, 0), Corners=1)
rec = Rectangle(offset)
trim = TrimWithRegion(Curve=rec, Region=offset_2)  # -> Inside, Outside
trim_2 = TrimWithRegion(Curve=offset_2, Region=rec)  # -> Inside, Outside
crv = Curve(trim.Inside)
crv_2 = Curve(trim_2.Inside)
join = JoinCurves(Curves=[crv, crv_2], Preserve=False)

# ---- group: my pattern / create engrave pattern
cir = Circle(Plane=hexgrid.Points, Radius=Slider(0.47, range=0..2))
trim_3 = TrimWithRegions(Curve=flatten(cir), Regions=flatten(offset_2))  # -> Inside, Outside
trim_4 = TrimWithRegion(Curve=trim_3.Outside, Region=rec)  # -> Inside, Outside
crv_3 = Curve(trim_4.Inside)

# ---- group: keep and re-use (continued)
# use 1/4 sheet of chip board
cube_magic = CubeMagic(
    box=box,
    rec=rectangle.Rectangle,
    face_selector=Slider(2, range=0..5),
    bake_cube=press_once,
    bake_pattern=bake_pattern,
    cut_curves=join,
    engrave_curves=crv_3)

# ==== cluster CubeMagic
face_selector = ClusterInput()  # input an integer 0-6 to choose which face to pattern
bake_cube = ClusterInput()

# ---- group: create a cube and unroll it with tabs and laser cutter settings / create laser cutter layout and move up out of the way
universal_colors = UniversalColors({"1 Black": "0,0,0", "2 Red": "255,0,0", "3 Blue": "0,0,255", "4 Yellow": "255,255,0", "5 Cyan": "0,255,255", "6 Green": "0,255,0", "7 Magenta": "255,0,255", "8 Orange": "255,102,0", "none": ""}, selected="8 Orange")
universal_inch = UniversalInch({Plane=PlaneXY(0, 0, 0), Size=Domain2(u=0..32, v=0..18)})
Y = UnitY(Factor=Slider(7, range=0..30))
button = Button()
move = Move(Geometry=universal_inch, Motion=Y)  # -> Geometry, Transform
laser_bake = LaserBake(bake=bake_cube, G=move.Geometry, col=universal_colors)

# ----
box = ClusterInput()
box_2 = Box(box)

# ---- group: create a cube and unroll it with tabs and laser cutter settings
unfold_for_laser = UnfoldForLaser(
    B=box_2,
    tab_spacing=1.25,
    tab_length=0.75,
    tab_depth=Slider(0.25, range=0..1),
    fold_dash_cut=0.125,
    fold_dash_keep=0.25,
    xy_dimensions_of_laser_bed_or_material_o=move.Geometry,
    margin=Slider(0.16, range=0..1),
    rotation_radians=expr("-x", 0))  # -> msg, cuts_2, all_folds_2, faces

# ----
rec = ClusterInput()
rec_2 = Rectangle(rec)
msg = ClusterOutput(unfold_for_laser.msg)
engrave_curves = ClusterInput()
item = ListItem(List=unfold_for_laser.faces, Index=face_selector, Wrap=True)
cut_curves = ClusterInput()

# ---- group: ports to move my pattern cuvers into the cube layout
engrave_curves_2 = Curve(engrave_curves)
cut_curves_2 = Curve(cut_curves)

# ---- group: move my patter to the cube layout
square_selector = Slider(0, range=0..5)
area = Area(Geometry=rec_2)  # -> Area, Centroid
area_2 = Area(Geometry=item)  # -> Area, Centroid
vec2pt = Vector2Pt(PointA=area.Centroid, PointB=area_2.Centroid, Unitize=False)  # -> Vector, Length
move_2 = Move(Geometry=engrave_curves_2, Motion=vec2pt.Vector)  # -> Geometry, Transform
move_3 = Move(Geometry=cut_curves_2, Motion=vec2pt.Vector)  # -> Geometry, Transform

# ----
bake_pattern = ClusterInput()

# ---- group: color the curves for laser output, and (optionally) bake to Rhino with color
universal_colors_2 = UniversalColors({"1 Black": "0,0,0", "2 Red": "255,0,0", "3 Blue": "0,0,255", "4 Yellow": "255,255,0", "5 Cyan": "0,255,255", "6 Green": "0,255,0", "7 Magenta": "255,0,255", "8 Orange": "255,102,0", "none": ""}, selected="2 Red")
universal_colors_3 = UniversalColors({"1 Black": "0,0,0", "2 Red": "255,0,0", "3 Blue": "0,0,255", "4 Yellow": "255,255,0", "5 Cyan": "0,255,255", "6 Green": "0,255,0", "7 Magenta": "255,0,255", "8 Orange": "255,102,0", "none": ""}, selected="6 Green")
universal_colors_4 = UniversalColors({"1 Black": "0,0,0", "2 Red": "255,0,0", "3 Blue": "0,0,255", "4 Yellow": "255,255,0", "5 Cyan": "0,255,255", "6 Green": "0,255,0", "7 Magenta": "255,0,255", "8 Orange": "255,102,0", "none": ""}, selected="5 Cyan")
universal_colors_5 = UniversalColors({"1 Black": "0,0,0", "2 Red": "255,0,0", "3 Blue": "0,0,255", "4 Yellow": "255,255,0", "5 Cyan": "0,255,255", "6 Green": "0,255,0", "7 Magenta": "255,0,255", "8 Orange": "255,102,0", "none": ""}, selected="3 Blue")
button_2 = Button()
button_3 = Button()
laser_bake_2 = LaserBake(bake=bake_cube, G=unfold_for_laser.cuts_2, col=universal_colors_3)
laser_bake_3 = LaserBake(bake=bake_cube, G=unfold_for_laser.all_folds_2, col=universal_colors_5)
laser_bake_4 = LaserBake(bake=bake_pattern, G=move_3.Geometry, col=universal_colors_4)
laser_bake_5 = LaserBake(bake=bake_pattern, G=move_2.Geometry, col=universal_colors_2)

# ==== cluster LaserBake: Bakes geometry into Rhino on on named and color-coordinated layers.
panel = Panel("""Black - Raster Engrave
Red - Vector Etch (Pattern)
Blue - Cut (Folds)
Desert Blue
Cyan - Cut (Pattern)
Green - Cut (Perimeter)
Grass Green 
Forest Green
Olive
Brown
Walnut
Plum
Purple
Magenta
Orange
Yellow""")
col = ClusterInput()
rgb = Data(["0,0,0", "255,0,0", "0,0,255", "51,102,153", "0,255,255", "0,255,0", "0,153,51", "0,102,51", "153,153,51", "153,102,51", "102,51,0", "102,0,102", "153,0,204", "255,0,255", "255,102,0", "255,255,0"])
col_2 = Colour(col)
col_3 = Colour(rgb)
mindex = MemberIndex(Set=col_3, Member=col_2)  # -> Index, Count
item = ListItem(List=panel, Index=mindex.Index, Wrap=True)
G = ClusterInput()
bake = ClusterInput()
preview = CustomPreview(Geometry=G, Shader=col_2)
filter = StreamFilter(Gate=bake, Stream1=item)
layers = CreateModifyLayers(LayerName=filter, LayerColor=col_2, DeleteLayer=False, enableFullPath=False)  # -> LayerNames, LayerFullPath
createatts = CreateAttributes(LayerName=layers.LayerNames, enableFullPath=False)
bake_2 = BakeGeometry(Bake=bake, Geometry=G, Attributes=createatts)

# ==== cluster UnfoldForLaser: Unfolds input geometry, adds tabs, creates dashed lines for folds and solid lines for cuts. generates color coded preview, and gives the option to bake into preset layers.
xy_dimensions_of_laser_bed_or_material_o = ClusterInput()  # Rectangle with the XY dimensions of laser Bed or Material,Used to create preview geometry of the bed/material
rotation_radians = ClusterInput()  # this input allows you to rotate the geometry to better fit it on your sheet.
margin = ClusterInput()  # margin cut geometry will be placed from the edge of the sheet ( tab depth will be added to this number to accomdate for this addition)
B = ClusterInput()  # input geometry must be a developable polysurface. To ovoid overlapping shapes, it may require breaking up the polysurface and using multiple instances of papercut to reconstruct the geometry.
unroll = VBScript(
    B=B,
    TooltipDescriptionOverride="run the Rhino command \"Unroll Developable Surface\" Outputs planar surfaces (S) and any error messages (M)",
    TooltipTextOverride="run the Rhino command \"Unroll Developable Surface\"")  # -> Out, S; inputs B: Brep
# ---------- unroll: VB ----------
    Dim Tol As Double = doc.ModelAbsoluteTolerance

    Dim Unroll As Unroller

    Unroll = New Unroller(B)

    Unroll.ExplodeOutput = False
    Unroll.RelativeTolerance = Tol

    S = unroll.PerformUnroll(Nothing, Nothing, Nothing)
# ---------- end unroll ----------
tab_spacing = ClusterInput()  # minumum distance between tabs
tab_depth = ClusterInput()  # protrusion of the tab off of the edge

# ---- group: position geometry on sheet
rec = Rectangle(xy_dimensions_of_laser_bed_or_material_o)
rotate = Rotate(Geometry=unroll.S, Angle=rotation_radians, Plane=PlaneXY(0, 0, 0))  # -> Geometry, Transform
box = EvaluateBox(Box=rec, UParameter=0, VParameter=1, WParameter=0)  # -> Plane, Point, Include

# ---- group: position geometry on sheet / move geometry to center of sheet
bbox = BoundingBox(Content=rotate.Geometry, Plane=PlaneXY(0, 0, 0), UnionBox=True)  # -> Box, Box_2
null = NullItem(Item=xy_dimensions_of_laser_bed_or_material_o)  # -> NullFlags, InvalidFlags, Description

# ---- group: position geometry on sheet / confirm geometry fits on sheet
drec = DeconstuctRectangle(Rectangle=rec)  # -> BasePlane, XInterval, YInterval
debox = DeconstructBox(Box=bbox.Box)  # -> Plane, X, Y, Z
panel = Panel("Cuts do not currently fit on sheet. Rotate and/or scale the shapes.")
smaller = SmallerThan(FirstNumber=debox.X, SecondNumber=drec.XInterval)  # -> SmallerThan, OrEqualTo
smaller_2 = SmallerThan(FirstNumber=debox.Y, SecondNumber=drec.YInterval)  # -> SmallerThan, OrEqualTo
and = GateAnd(A=smaller.SmallerThan, B=smaller_2.SmallerThan)
filter = StreamFilter(Gate=and, Stream0=panel, Stream1="All cuts fit on sheet.")

# ----
rec_2 = Rectangle(bbox.Box)
msg = ClusterOutput([unroll.Out, filter])  # errror message from Unroll

# ---- group: tabs
tab_length = ClusterInput()  # length of the tab along the edge
tab_spacing_2 = Number(tab_spacing)
tab_length_2 = Number(tab_length)
tab_depth_2 = Number(tab_depth)
max = Maximum(A=tab_spacing_2, B=0.001)
dom = ConstructDomain(DomainStart=expr("x*-1", tab_depth_2), DomainEnd=tab_depth_2)

# ----
addition = Addition(A=tab_depth_2, B=margin)
offset = Offset(Curve=rec_2, Distance=addition, Plane=PlaneXY(0, 0, 0), Corners=1)

# ---- group: position geometry on sheet / move geometry to center of sheet (continued)
box_2 = EvaluateBox(Box=offset, UParameter=0, VParameter=1, WParameter=0)  # -> Plane, Point, Include
vec2pt = Vector2Pt(PointA=box_2.Point, PointB=box.Point, Unitize=False)  # -> Vector, Length
move = Move(Geometry=rotate.Geometry, Motion=vec2pt.Vector)  # -> Geometry, Transform

# ---- group: position geometry on sheet (continued)
filter_2 = StreamFilter(Gate=null.NullFlags, Stream0=move.Geometry, Stream1=rotate.Geometry)

# ----
join = BrepJoin(Breps=filter_2)  # -> Breps, Closed
geo = Geometry(join.Breps)

# ---- group: break down the unrolled geometry / perimeter lines
fmerge = MergeFaces(Brep=geo)  # -> Breps, Before, After
edges = BrepEdges(Brep=fmerge.Breps)  # -> Naked, Interior, NonManifold
join_2 = JoinCurves(Curves=flatten(edges.Naked), Preserve=False)
explode = Explode(Curve=join_2, Recursive=True)  # -> Segments, Vertices

# ---- group: break down the unrolled geometry / these interior curves are fold lines
edges_2 = BrepEdges(Brep=geo)  # -> Naked, Interior, NonManifold

# ---- group: break down the unrolled geometry / output the faces
debrep = DeconstructBrep(Brep=geo)  # -> Faces, Edges, Vertices

# ----
faces = ClusterOutput(debrep.Faces)

# ---- group: tabs (continued)
perimeter_segments = Curve(simplify(graft(explode.Segments)))
ext = ExtendCurve(Curve=perimeter_segments, Type=0, Start=expr("x*-1.5", tab_depth_2), End=expr("x*-1.5", tab_depth_2))
len = Length(Curve=ext)
division = Division(A=len, B=2)
min = Minimum(A=division, B=tab_length_2)
eval = Evaluate(F="floor(x/(y+z))", x=len, y=max, z=min)
max_2 = Maximum(A=eval, B=1)
min_2 = Minimum(A=max_2, B=20)
divide = DivideCurve(Curve=ext, Count=min_2, Kinks=False)  # -> simplify(Points), simplify(Tangents), Parameters
lng = ListLength(List=divide.Tangents)  # -> expr("x-1", Length)
cull_i = CullIndex(List=divide.Points, Indices=lng, Wrap=True)  # -> simplify(List)
crv_cp = CurveClosestPoint(Point=cull_i, Curve=ext)  # -> Point, Parameter, Distance
hframe = HorizontalFrame(Curve=ext, Parameter=crv_cp.Parameter)
rectangle = Rectangle(Plane=hframe, XSize=graft(min), YSize=dom, Radius=expr("x*.5", tab_depth_2))  # -> simplify(Rectangle), Length
trim = TrimWithRegions(Curve=rectangle.Rectangle, Regions=flatten(join_2))  # -> Inside, Outside
tabs = Curve(flatten(trim.Outside))

# ---- group: make folding lines at tabs
graft = GraftTree(Tree=join_2, IncludeEmptyLists=True, IncludeNullItems=True)  # -> simplify(Tree)
trim_2 = TrimWithRegions(Curve=graft, Regions=flatten(rectangle.Rectangle))  # -> Inside, Outside
tab_fold = Curve(flatten(trim_2.Inside))
perimeter = Curve(flatten(trim_2.Outside))

# ---- group: cut lines
all_cuts = Curve(flatten([perimeter, tabs]))
join_3 = JoinCurves(Curves=all_cuts, Preserve=False)
cuts = Curve(flatten(join_3))

# ----
cuts_2 = ClusterOutput(cuts)  # exterior cut lines These line will not be dashed.

# ---- group: folds
fold_dash_keep = ClusterInput()  # size of the gap between the cuts. A higer number will leave more material. Set this to 0 for solid cut lines (these could be lightly cut into the surface with the laser)
fold_dash_cut = ClusterInput()  # length of the cut in the dashed fold lines. Set to 0 to have no fold lines.
dash_length = Number(fold_dash_cut)
gap_length = Number(fold_dash_keep)
dash = DashPattern(Curve=edges_2.Interior, Pattern=[dash_length, gap_length])  # -> Dashes, Gaps
ext_2 = ExtendCurve(Curve=tab_fold, Type=0, Start=expr("x*.5", gap_length), End=0)
folds = Curve(flatten(dash.Dashes))

# ---- group: folds / tab folds
dash_2 = DashPattern(Curve=ext_2, Pattern=expr("x*.5", [dash_length, gap_length]))  # -> Dashes, Gaps
tab_fold_lines = Curve(flatten(dash_2.Dashes))

# ---- group: folds (continued)
all_folds = Curve(flatten([folds, tab_fold_lines]))

# ----
all_folds_2 = ClusterOutput(all_folds)

# ---- group: create colored previews
trotec_colors = ValueList({"1 Black": "0,0,0", "2 Red": "255,0,0", "3 Blue": "0,0,255", "4 Desert Blue": "51,102,153", "5 Cyan": "0,255,255", "6 Green": "0,255,0", "7 Grass Green": "0,153,51", "8 Forest Green": "0,102,51", "9 Olive": "153,153,51", "10 Brown": "153,102,51", "11 Walnut": "102,51,0", "12 Plum": "102,0,102", "13 Purple": "153,0,204", "14 Magenta": 255,0,255, "15 Orange": 255,102,0, "16 Yellow": 255,255,0}, selected="3 Blue")
trotec_colors_2 = ValueList({"1 Black": "0,0,0", "2 Red": "255,0,0", "3 Blue": "0,0,255", "4 Desert Blue": "51,102,153", "5 Cyan": "0,255,255", "6 Green": "0,255,0", "7 Grass Green": "0,153,51", "8 Forest Green": "0,102,51", "9 Olive": "153,153,51", "10 Brown": "153,102,51", "11 Walnut": "102,51,0", "12 Plum": "102,0,102", "13 Purple": "153,0,204", "14 Magenta": 255,0,255, "15 Orange": 255,102,0, "16 Yellow": 255,255,0}, selected="6 Green")
trotec_colors_3 = TrotecColorSelector({"1 Black": "0,0,0", "2 Red": "255,0,0", "3 Blue": "0,0,255", "4 Desert Blue": "51,102,153", "5 Cyan": "0,255,255", "6 Green": "0,255,0", "7 Grass Green": "0,153,51", "8 Forest Green": "0,102,51", "9 Olive": "153,153,51", "10 Brown": "153,102,51", "11 Walnut": "102,51,0", "12 Plum": "102,0,102", "13 Purple": "153,0,204", "14 Magenta": "255,0,255", "15 Orange": "255,102,0", "16 Yellow": "255,255,0"}, selected="2 Red")
rec_3 = Rectangle(xy_dimensions_of_laser_bed_or_material_o)
preview = CustomPreview(Geometry=cuts, Shader=trotec_colors_2)
preview_2 = CustomPreview(Geometry=rec_3, Shader=trotec_colors_3)
preview_3 = CustomPreview(Geometry=all_folds, Shader=trotec_colors)
