# Grasshopper definition geometry_demo.gh (Grasshopper 1.0.4)
# Copyright: Use it.  Mod it.  Share it. Just please give credit and kepp this party going.

# ---- group: point constructor
pt = ConstructPoint(XCoordinate=Slider(3, range=0..10), YCoordinate=Slider(7, range=0..10), ZCoordinate=Slider(0, range=0..10))

# ---- group: point container
# These examples demonstrate how to create basic geometry in Grasshopper.
# Note that the preview of all of the components are turned off.
# See the preview of each item, right-click it or
# select multiple components and right-click the canvas,
# then choose to turn the preview on.
pt_2 = Point()

# ---- group: rectangle from point
pt_3 = ConstructPoint(XCoordinate=Slider(0, range=0..10), YCoordinate=Slider(0, range=0..10), ZCoordinate=Slider(0, range=0..10))
xy = XYPlane(Origin=pt_3)
rectangle = Rectangle(Plane=xy, XSize=Slider(5.175, range=0..10), YSize=Slider(2.75, range=0..10), Radius="0")  # -> Rectangle, Length
panel = Panel(rectangle.Rectangle)

# ---- group: points to line
pt_4 = ConstructPoint(XCoordinate=Slider(0, range=0..10), YCoordinate=Slider(0, range=0..10), ZCoordinate=Slider(0, range=0..10))
pt_5 = ConstructPoint(XCoordinate=Slider(7, range=0..10), YCoordinate=Slider(7, range=0..10), ZCoordinate=Slider(4, range=0..10))
ln = Line(StartPoint=pt_4, EndPoint=pt_5)

# ---- group: create a vector from 2 points
pt_6 = ConstructPoint(XCoordinate=Slider(0, range=0..10), YCoordinate=Slider(2, range=0..10), ZCoordinate=Slider(0, range=0..10))
pt_7 = ConstructPoint(XCoordinate=Slider(7, range=0..10), YCoordinate=Slider(5, range=0..10), ZCoordinate=Slider(2, range=0..10))
vec2pt = Vector2Pt(PointA=pt_6, PointB=pt_7, Unitize=False)  # -> Vector, Length
vdis = VectorDisplay(Anchor=pt_6, Vector=vec2pt.Vector)

# ---- group: make 4 points
number_slider = Slider(0, range=0..10)
number_slider_2 = Slider(10, range=0..10)
number_slider_3 = Slider(1, range=0..10)
number_slider_4 = Slider(9, range=0..10)
pt_8 = ConstructPoint(XCoordinate=number_slider_3, YCoordinate=number_slider, ZCoordinate=0)
pt_9 = ConstructPoint(XCoordinate=number_slider_3, YCoordinate=number_slider_2, ZCoordinate=0)
pt_10 = ConstructPoint(XCoordinate=number_slider_4, YCoordinate=number_slider_2, ZCoordinate=0)
pt_11 = ConstructPoint(XCoordinate=number_slider_4, YCoordinate=number_slider, ZCoordinate=0)
pt_12 = Point([pt_8, pt_9, pt_10, pt_11])

# ---- group: polyline open
pline = PolyLine(Vertices=pt_12, Closed=Toggle(False))

# ---- group: polyline closed
pline_2 = PolyLine(Vertices=pt_12, Closed=Toggle(True))

# ---- group: nurbs curve
nurbs = NurbsCurve(Vertices=pt_12, Degree=3, Periodic=Toggle(True))  # -> Curve, Length, Domain

# ---- group: interpolate curve
intcrv = Interpolate(Vertices=pt_12, Degree=3, Periodic=Toggle(True), KnotStyle=1)  # -> Curve, Length, Domain

# ---- group: loft
Z = UnitZ(Factor=Slider(5, range=0..10))
move = Move(Geometry=intcrv.Curve, Motion=Z)  # -> Geometry, Transform
loft = Loft(
    Curves=[nurbs.Curve, move.Geometry],
    Options={Adjust=True, Closed=False, LoftEnds=0, LoftSimp=0, LoftType=0, Rebuild=10, Refit=0.01})

# ---- group: pipe (we didn't get to this in class but it is a fun one)
pipe = Pipe(Curve=pline, Radius=Slider(2, range=0..10), Caps=Slider(2, range=0..2))

# ---- group: create a planar surface
boundary = BoundarySurfaces(Edges=pline_2)

# ---- group: extrude
Z_2 = UnitZ(Factor=Slider(5, range=0..10))
extr = Extrude(Base=nurbs.Curve, Direction=Z_2)
cap = CapHoles(Brep=extr)

# ---- group: divided line
Y = UnitY(Factor=Slider(5.52, range=0..12))
X = UnitX(Factor=Slider(2.28, range=0..12))
pt_13 = Point(<point referenced from the Rhino model>)
move_2 = Move(Geometry=pt_13, Motion=Y)  # -> Geometry, Transform
num_segments = Slider(18, range=0..40)
num_segments_2 = Slider(18, range=0..40)

# ---- group: divided line / line A
ln_2 = Line(StartPoint=pt_13, EndPoint=move_2.Geometry)

# ---- group: divided line / line B
move_3 = Move(Geometry=ln_2, Motion=X)  # -> Geometry, Transform

# ---- group: divided line (continued)
divide = DivideCurve(Curve=ln_2, Count=num_segments, Kinks=False)  # -> Points, Tangents, Parameters
divide_2 = DivideCurve(Curve=move_3.Geometry, Count=num_segments_2, Kinks=False)  # -> Points, Tangents, Parameters
ln_3 = Line(StartPoint=divide.Points, EndPoint=divide_2.Points)
