# Grasshopper definition sequences_demo.gh (Grasshopper 0.9.76)
# Copyright: Use it.  Mod it.  Share it. Just please give credit and kepp this party going.

# ---- group: construct domain
# ------------------------------ domains -------------------------------
number_slider = Slider(2, range=0..10)
dom = ConstructDomain(DomainStart=number_slider, DomainEnd=Slider(10, range=0..10))
panel = Panel(dom)

# ---- group: if given a single number when expecting a domain, GH assumes 0 to X
domain = Domain(Slider(10, range=0..10))
panel_2 = Panel(domain)

# ---- group: bounds
panel_3 = Panel("""5
23
8
26.3
57
18
8
24""")
bnd = Bounds(Numbers=panel_3)
panel_4 = Panel(bnd)

# ---- group: deconstruct domain
domain_2 = Domain(Domain(2, 10))
dedomain = DeconstructDomain(Domain=domain_2)  # -> Start, End
panel_5 = Panel(dedomain.Start)
panel_6 = Panel(dedomain.End)

# ---- group: domain parameter
# A domain is simply a range of numbers
# defined by a start point and an end point.
# Here are a few components that enable
# you to create and manage domains.
domain_3 = Domain(Domain(0.2, 10))
# ------------------------------------------------------------ sequences ------------------------------------------------------------
panel_7 = Panel(domain_3)

# ---- group: generate a list of random numbers
dom_2 = ConstructDomain(DomainStart=Slider(0, range=0..10), DomainEnd=Slider(10, range=0..10))
random = Random(Range=dom_2, Number=Slider(10, range=0..10), Seed=Slider(10, range=0..10))
# The "Random" component creates a list
# of random numbers based on the inputs of
# R - a domain of numbers
#       all your random numbers will fall within
#       the start and end points of the domain
# N - the number of random numbers you want
# S - the "seed" the value of which isn't critical,
#       but changing this number give you different
#       random numbers
panel_8 = Panel(random)

# ---- group: range, divide a domain into N parts
number_slider_2 = Slider(10, range=0..10)
dom_3 = ConstructDomain(DomainStart=Slider(0, range=0..10), DomainEnd=Slider(10, range=0..10))
range = Range(Domain=dom_3, Steps=number_slider_2)
# The "Range" component creates a list
# of numbers based upon the inputs of
# D - a domain of numbers
#      which is simply defined by a
#     start and end point
# N - number of divisions in the domain
# 
# note: this creates N +1 numbers in the list
# because it includes the start and end points
panel_9 = Panel(range)

# ---- group: series
series = Series(Start=Slider(0, range=0..10), Step=Slider(1, range=0..10), Count=Slider(10, range=0..10))
# The "Series" component creates a list
# of numbers based upon the inputs of
# S - starting point
# N - step size
# C - count of numbers you want
panel_10 = Panel(series)

# ----
range_2 = Range(Domain=dom_3, Steps=number_slider_2)

# ---- group: manually create a sequence by typing into a panel
# You can make a list with a"panel."
# If you have more than one item in your list,
# you'll need to right-click the panel
# and set it to "multi-line data."
panel_11 = Panel("""0.0
1.0
2.0
3.0
4.0
5.0
6.0
7.0
8.0
9.0""")
