# Grasshopper definition datatree-basic-manipulation.gh (Grasshopper 1.0.4)

recgrid = Rectangular(Plane=PlaneXY(0, 0, 0), SizeX=1, SizeY=2, ExtentX=10, ExtentY=5)  # -> Cells, Points
pt = Point(recgrid.Points)
graft = GraftTree(Tree=pt, IncludeEmptyLists=True, IncludeNullItems=True)
viewer = ParamViewer(pt)
pshift = ShiftPaths(Data=graft, Offset="-1")
viewer_2 = ParamViewer(graft)
simplify = SimplifyTree(Tree=pshift, Front=False)
# graft creates a branch
# for every data item
viewer_3 = ParamViewer(pshift)
flatten = FlattenTree(Tree=simplify, Path="{0}")
# shift removes a level of data
# (offsets the indicies by a #)
viewer_4 = ParamViewer(simplify)
# Simplify removes unneccessary zeros
# flatten removes all levels
# resulting in a single branch
viewer_5 = ParamViewer(flatten)
