# Grasshopper definition lists1.gh (Grasshopper 1.0.4)

# ---- group: data matching
# Explore the effect
# of mismatched
# number of inputs.
number_slider = Slider(2, range=0..10)
series = Series(Start=0, Step=Slider(2, range=0..10), Count=Slider(5, range=0..100))
pt = ConstructPoint(XCoordinate=series, YCoordinate=number_slider, ZCoordinate=0)

# ---- group: list of points
series_2 = Series(Start=0, Step=Slider(1.516, range=0..6), Count=Slider(10, range=1..20))
pt_2 = ConstructPoint(XCoordinate=series_2, YCoordinate=Slider(1.87, range=0..6), ZCoordinate=0)
list_of_points = Panel(pt_2)

# ---- group: data matching
series_3 = Series(Start=0, Step=Slider(2, range=0..10), Count=Slider(5, range=0..100))
# Explore the efect of
# grafting one input
# into the line
pt_3 = ConstructPoint(XCoordinate=series_3, YCoordinate=Slider(10, range=0..10), ZCoordinate=0)

# ---- group: single point
pt_4 = ConstructPoint(XCoordinate=Slider(0.25, range=0..6), YCoordinate=Slider(3.37, range=0..6), ZCoordinate=0)
panel = Panel(pt_4)

# ----
graft = GraftTree(IncludeEmptyLists=True, IncludeNullItems=True)

# ---- group: data matching
ln = Line(StartPoint=pt, EndPoint=pt_3)

# ----
panel_2 = Panel(ln)
viewer = ParamViewer(ln)

# ---- group: point box by flattening
series_4 = Series(Start=0, Step=Slider(2, range=0..10), Count=Slider(11, range=0..100))
series_5 = Series(Start=0, Step=Slider(2, range=0..10), Count=Slider(19, range=0..100))
series_6 = Series(Start=0, Step=Slider(2, range=0..10), Count=Slider(11, range=0..100))
# Note that one input is grafted.
# This creates a grid of points
# instead of a diagonal line.
# You can right-click inputs and outputs
# to graft, flatten, or simplify them.
pt_5 = ConstructPoint(XCoordinate=graft(series_5), YCoordinate=series_6, ZCoordinate=0)
# Here we have a flattened grid in the XY
# and a grafted list in the Z.
# This mactches every point in the XY
# to each move distance in the Z.
# This create a 3D grid of points.
Z = UnitZ(Factor=series_4)
move = Move(Geometry=flatten(pt_5), Motion=graft(Z))  # -> Geometry, Transform

# ---- group: x vales
series_7 = Series(Start=0, Step=Slider(1.516, range=0..6), Count=Slider(10, range=1..20))

# ---- group: y values
series_8 = Series(Start=0, Step=Slider(1.51, range=0..6), Count=Slider(10, range=1..20))

# ----
# this illustrates how data is ordered and stored
graft_2 = GraftTree(Tree=series_7, IncludeEmptyLists=True, IncludeNullItems=True)
pt_6 = ConstructPoint(XCoordinate=graft_2, YCoordinate=series_8, ZCoordinate=0)
points = PointList(Points=pt_6, Size=Slider(0.764, range=0..1))
graft_3 = GraftTree(Tree=pt_6, IncludeEmptyLists=True, IncludeNullItems=True)
tstat = TreeStatistics(Tree=graft_3)  # -> Paths, Length, Count
viewer_2 = ParamViewer(graft_3)
graft_4 = GraftTree(Tree=tstat.Paths, IncludeEmptyLists=True, IncludeNullItems=True)
tag = TextTag3D(Location=graft_3, Text=graft_4, Size=Slider(0.278, range=0..1), Justification=7)
list_of_lists = Panel(graft_4)

# ---- group: grid of points
series_9 = Series(Start=0, Step=Slider(1.516, range=0..6), Count=Slider(10, range=1..20))
series_10 = Series(Start=0, Step=Slider(1.51, range=0..6), Count=Slider(10, range=1..20))

# ----
crossref = CrossReference(ListA=series_9, ListB=series_10, CrossMode=1)  # -> ListA, ListB

# ---- group: grid of points (continued)
# graft x and connect
# series to x and y dirrectly
pt_7 = ConstructPoint(XCoordinate=crossref.ListA, YCoordinate=crossref.ListB, ZCoordinate=0)
still_a_list = Panel(pt_7)

# ----
points_2 = PointList(Points=pt_7)
